% Requirement links of TestingScript.m (R2025b)

% line 5 verifies Requirements.slreqx#42
        function verifyWingUnfoldedSpan(testCase)

% line 10 verifies Requirements.slreqx#43
        function verifyWingFoldedSpan(testCase)

% line 14 verifies Requirements.slreqx#45
        function verifyAircraftHeight(testCase)

% line 21 verifies Requirements.slreqx#44
        function verifyAircraftLength(testCase)

% line 25 verifies Requirements.slreqx#8
        function verifyNumEngines(testCase)

% line 29 verifies Requirements.slreqx#36
        function verifyDesignLoadFactor(testCase)

% line 33 verifies Requirements.slreqx#25
        function verifyA2ACombatRadius(testCase)

% line 39 verifies Requirements.slreqx#31
        function verifyA2GCombatRadius(testCase)

% line 45 verifies Requirements.slreqx#18
        function verifyCMEA(testCase)

% line 53 verifies Requirements.slreqx#19
        function verifyLandingSpeed(testCase)

% line 60 verifies Requirements.slreqx#47
        function verifyMTOW(testCase)

% line 68 verifies Requirements.slreqx#41
        function verifyLandingSEROC(testCase)

% line 85 verifies Requirements.slreqx#40
        function verifyCMEA_SEROC(testCase)

% line 101 verifies Requirements.slreqx#37
        function verifyExternalStores(testCase)

% line 105 verifies Requirements.slreqx#33
        function verifySeaLevelDash(testCase)

% line 112 verifies Requirements.slreqx#29
        function verifyCombatDash(testCase)

% line 120 verifies Requirements.slreqx#28
        function verifyTurnRate(testCase)